# Dynamo graph 四项处理.dyn (Dynamo 2.0.0.5801)

file_path = Filename("..\..\..\data\IMG-0003-00001.dcm")
readDicomFromPath = DicomTools.DicomReader.ReadDicomFromPath(filepath=file_path)
matToBitmap = ImageProc.Converter.MatToBitmap(mat=readDicomFromPath)
watch_image = WatchImageCore(image=matToBitmap)
number_slider = DoubleSlider(52.2, range=0..100 step 0.1)
boolean = BoolSelector(true)
binnary = ImageProc.Processor.Binnary(inMat=readDicomFromPath, Threshold=number_slider, reverse=boolean)
matToBitmap_2 = ImageProc.Converter.MatToBitmap(mat=binnary)
watch_image_2 = WatchImageCore(image=matToBitmap_2)
color_palette = ColorPalette({R: 0, G: 0, B: 0, A: 255})
clearBorder = ImageProc.Processor.ClearBorder(inMat=binnary, color=color_palette)
sobel = ImageProc.Processor.Sobel(mat=clearBorder)
matToBitmap_3 = ImageProc.Converter.MatToBitmap(mat=sobel)
watch_image_3 = WatchImageCore(image=matToBitmap_3)
file_path_2 = Filename("F:\binnary322.png")
matToBitmap_4 = ImageProc.Converter.MatToBitmap(mat=clearBorder)
watch_image_4 = WatchImageCore(image=matToBitmap_4)
writeToFile = Image.WriteToFile(path=file_path_2, image=watch_image_4)
