# Dynamo graph 目标确定.dyn

filename = Filename("F:\IMG-0003-00001.dcm")
readDicomFromPath = DicomTools.DicomReader.ReadDicomFromPath(filepath=filename)
doubleSlider = DoubleSlider(50.4, range=0..100 step 0.1)
boolSelector = BoolSelector(true)
binnary = ImageProc.Processor.Binnary(inMat=readDicomFromPath, Threshold=doubleSlider, reverse=boolSelector)
colorPalette = ColorPalette(DsColor={Red: 0, Green: 0, Blue: 0, Alpha: 255})
clearBorder = ImageProc.Processor.ClearBorder(inMat=binnary, color=colorPalette.out0)
integerSlider = IntegerSlider(3, range=0..100 step 1)
erode = ImageProc.Processor.Erode(inMat=clearBorder, Size=integerSlider)
integerSlider_2 = IntegerSlider(10, range=0..100 step 1)
close = ImageProc.Processor.Close(inMat=erode, Size=integerSlider_2)
integerSlider_3 = IntegerSlider(0, range=0..100 step 1)
maxRegion = ImageProc.Processor.MaxRegion(inMat=close, Num=integerSlider_3)
matToBitmap = ImageProc.Converter.MatToBitmap(mat=maxRegion)
watchImageCore = WatchImageCore(image=matToBitmap)
matToBitmap_2 = ImageProc.Converter.MatToBitmap(mat=readDicomFromPath)
watchImageCore_2 = WatchImageCore(image=matToBitmap_2)
